# Grasshopper definition AcousticMeshStudyColors-Final.gh (Grasshopper 1.0.7)
# plug-ins: LunchBox

panel = Panel("ADDITIONAL CONTEXT GEOMETRY")
# (THIS SHOULD HAVE NO HOLES THAT MAY ALLOW PARTICLES TO ESCAPE
panel_2 = Panel("REQUIRED CONTEXT GEOMETRY")
panel_3 = Panel("SOUND SOURCE POINT")
panel_4 = Panel("(OPTIONAL)")
# THIS GEOMETRY CAN BE ASSIGNED A DIFFERENT NRC (NOISE REDUCTION VALUE)
panel_5 = Panel("(OPTIONAL)")

# ---- group: NRC
number_slider = Slider(0.6, range=0..1)

# ----
pt = Point(<point referenced from the Rhino model>)

# ---- group: Horizontal Cutting Plane
# ROUGHLY AT EAR HEIGHT
mesh = Mesh(<mesh referenced from the Rhino model>)

# ---- group: NEW GEOMERTY
geo = Geometry([<brep referenced from the Rhino model> x3])

# ---- group: ADDITIONAL GEOMETRY
geo_2 = Geometry([<brep referenced from the Rhino model> x6])

# ---- group: EXISITING CONTEXT
geo_3 = Geometry([<mesh referenced from the Rhino model> x17])

# ---- group: GEOMETRY PREP
number_slider_2 = Slider(700, range=0..1000)
panel_6 = Panel("12")

# ---- group: GEOMETRY PREP / Create sound vectors
pt_2 = ConstructPoint(XCoordinate=0, YCoordinate=0, ZCoordinate=0)
mesh_2 = Mesh(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)
vec2pt = Vector2Pt(PointA=pt_2, PointB=pt, Unitize=False)  # -> Vector, Length
move = Move(Geometry=mesh_2, Motion=vec2pt.Vector)  # -> Geometry, Transform
demesh = DeconstructMesh(Mesh=move.Geometry)  # -> Vertices, Faces, Colours, Normals
vec2pt_2 = Vector2Pt(PointA=pt, PointB=demesh.Vertices, Unitize=False)  # -> Vector, Length

# ---- group: GEOMETRY PREP
# CONNECT IF YOU WANT TO SEE THE DIFFERENCE BETWEEN EXISTING FABLAB AND FABLAB w/ NEW GEO
pt_3 = Point(pt)
mesh_3 = Mesh(geo_3)
mesh_4 = Mesh(geo_2)
mesh_5 = Mesh(geo)
data = Data(pt_3)
geo_4 = Merge03(StreamA=geo_3, StreamB=mesh_4, StreamC=mesh_5)
unit = UnitVector(Vector=vec2pt_2.Vector)

# ----
panel_7 = Panel("NOW IT'S CONNECTED")

# ---- group: RAYTRACING ENGINE
forwardraytracing = Ladybug_ForwardRaytracing(startPts=graft(data), startVectors=unit, context=flatten(geo_4), numOfBounce=panel_6, lastBounceLen=number_slider_2)  # -> simplify(rays); plug-in component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

# ----
data_2 = Data(forwardraytracing)

# ---- group: Clean lines
number_slider_3 = Slider(600, range=0..1000)  # disabled
number_slider_4 = Slider(3, range=0..10)  # disabled

data_3 = Data(forwardraytracing)  # disabled
disc = Discontinuity(Curve=data_3, Level=1)  # -> Points, simplify(Parameters); disabled
graft = GraftTree(Tree=data_3, IncludeEmptyLists=True, IncludeNullItems=True)  # -> simplify(Tree); disabled
shatter = Shatter(Curve=graft, Parameters=disc.Parameters)  # -> simplify(Segments); disabled
panel_8 = Panel("-1")  # disabled
cull_i = CullIndex(List=shatter, Indices=panel_8, Wrap=True)  # disabled
join = JoinCurves(Curves=cull_i, Preserve=False)  # -> flatten(Curves); disabled
data_4 = Data(join)  # disabled
reb = RebuildCurve(Curve=data_4, Degree=number_slider_4, Count=number_slider_3, Tangents=False)  # -> reparameterize(Curve); disabled

# ---- group: CALCULATE NOISE REDUCTION COEFFIEINTS
deface = DeconstructFace(Face=demesh.Faces)  # -> simplify(graft(CornerA)), simplify(graft(CornerB)), simplify(graft(CornerC)), CornerD; disabled
merge = Merge(Data1=deface.CornerA, Data2=deface.CornerB, Data3=deface.CornerC)  # disabled
item = ListItem(List=data_4, Index=merge, Wrap=True)  # -> simplify(Item); disabled
disc_2 = Discontinuity(Curve=item, Level=1)  # -> Points, Parameters; disabled
merge_2 = Merge(Data1=mesh_3, Data2=mesh_4)  # disabled
shatter_2 = Shatter(Curve=graft(item), Parameters=disc_2.Parameters)  # disabled
len = Length(Curve=shatter_2)  # disabled
mjoin = MeshJoin(Meshes=merge_2)  # disabled
meshcp = MeshClosestPoint(Point=disc_2.Points, Mesh=mjoin)  # -> Point, Index, Parameter; disabled
dist = Distance(PointA=disc_2.Points, PointB=meshcp.Point)  # disabled
number_slider_5 = Slider(1, range=0..1)  # disabled
int = Integer(dist)  # disabled
larger = LargerThan(FirstNumber=int, SecondNumber=number_slider_5)  # -> LargerThan, OrEqualTo; disabled
dispatch = Dispatch(List=int, DispatchPattern=larger.OrEqualTo)  # -> ListA, ListB; disabled
trim = TrimTree(Tree=dispatch.ListB, Depth=1)  # disabled
number_slider_6 = Slider(0.9, range=0..1)  # disabled
number_slider_7 = Slider(0.05, range=0..0.1)  # disabled
division = Division(A=dispatch.ListA, B=dispatch.ListA)  # disabled
lng = ListLength(List=trim)  # disabled
panel_9 = Panel("0.95")  # disabled
number_slider_8 = Slider(1, range=0..1)  # disabled
repeat = RepeatData(Data=panel_9, Length=lng)  # -> simplify(Data); disabled
subtraction = Subtraction(A=division, B=number_slider)  # disabled
panel_10 = Panel("0")  # disabled
panel_11 = Panel("0")  # disabled
weave = Weave(Pattern=larger.OrEqualTo, Stream0=repeat, Stream1=subtraction, NullGaps=False)  # disabled
cull_i_2 = CullIndex(List=weave, Indices=panel_10, Wrap=True)  # disabled
replace = ReplaceItems(List=cull_i_2, Item=number_slider_8, Indices=panel_11, Wrap=False)  # -> simplify(List); disabled

# ----
item_2 = ListItem(List=reb, Index=merge, Wrap=True)  # -> simplify(Item); disabled
data_5 = Data(item_2)  # disabled
len_2 = Length(Curve=data_5)  # disabled

# ----
# CHANGE THIS VALUE BASED ON YOUR COMPUTER'S RAM
# SHOULD BE NO MORE THAN 2x YOUR TOTAL RAM
# IT PROBABLY WONT CRASH... JUST SORT OF DO NOTHING AT 100% RAM USAGE UNTIL YOU KILL IT
# CHECK YOUR RAM IF SOMETHING SEEMS WRONG... IF IT GETS TO 100% and STAYS THERE IT IS PROBABLY OUT OF MEMORY AND JUST NOT GIVING UP
number_slider_9 = Slider(20, range=0..100)  # disabled

# ---- group: CALCULATE NOISE REDUCTION COEFFIEINTS / Travel Distances
data_6 = Data(simplify(len))  # disabled

# ---- group: CALCULATE NOISE REDUCTION COEFFIEINTS / Multipliers
data_7 = Data(replace)  # disabled

# ----
number_slider_10 = Slider(1000, range=0..1000)  # disabled
number_slider_11 = Slider(2000, range=0..10000)  # disabled
division_2 = Division(A=number_slider_10, B=number_slider_9)  # disabled

# ---- group: CREATE SOUND WAVES
panel_12 = Panel("3")  # disabled
multiplication = Multiplication(A=number_slider_9, B=panel_12)  # disabled
panel_13 = Panel("1")  # disabled
series = Series(Start=panel_13, Step=1, Count=number_slider_9)  # disabled
graft_2 = GraftTree(Tree=series, IncludeEmptyLists=True, IncludeNullItems=True)  # disabled
division_3 = Division(A=graft(graft_2), B=flatten(len_2))  # -> simplify(Result); disabled
panel_14 = Panel("3")  # disabled
partition = PartitionList(List=division_3, Size=panel_14)  # disabled
repeat_2 = RepeatData(Data=data_5, Length=graft(multiplication))  # -> simplify(Data); disabled
path_mapper = PathMapper(partition, source="{A;B}(i)", target="{B;i}(A)")  # disabled
panel_15 = Panel("3")  # disabled
data_8 = Data(path_mapper)  # disabled
partition_2 = PartitionList(List=repeat_2, Size=panel_15)  # disabled
panel_16 = Panel("25")  # disabled
path_mapper_2 = PathMapper(partition_2, source="{A;B}(i)", target="{A;i}(B)")  # disabled
panel_17 = Panel("1")  # disabled
multiplication_2 = Multiplication(A=data_8, B=division_2)  # disabled
larger_2 = LargerThan(FirstNumber=multiplication_2, SecondNumber=panel_17)  # -> LargerThan, OrEqualTo; disabled
dispatch_2 = Dispatch(List=multiplication_2, DispatchPattern=larger_2.OrEqualTo)  # -> ListA, ListB; disabled
division_4 = Division(A=dispatch_2.ListA, B=dispatch_2.ListA)  # disabled
weave_2 = Weave(Pattern=larger_2.OrEqualTo, Stream0=dispatch_2.ListB, Stream1=division_4, NullGaps=False)  # disabled
eval = EvaluateCurve(Curve=reparameterize(path_mapper_2), Parameter=weave_2)  # -> Point, Tangent, Angle; disabled
path_mapper_3 = PathMapper(eval.Point, source="{A;B}(i)", target="{i;A}(B)")  # disabled
item_3 = ListItem(List=data_4, Index=merge, Wrap=True)  # -> simplify(Item); disabled
panel_18 = Panel("3")  # disabled
data_9 = Data(path_mapper_3)  # disabled
multiplication_3 = Multiplication(A=number_slider_9, B=panel_18)  # disabled
repeat_3 = RepeatData(Data=item_3, Length=multiplication_3)  # disabled
triangle = MeshTriangle(CornerA=0, CornerB=1, CornerC=2)  # disabled
partition_3 = PartitionList(List=repeat_3, Size=panel_18)  # -> simplify(Chunks); disabled
conmesh = ConstructMesh(Vertices=data_9, Faces=simplify(graft(triangle)))  # disabled
path_mapper_4 = PathMapper(partition_3, source="{A;B}(i)", target="{B;A}(i)")  # disabled
trim_2 = TrimTree(Tree=conmesh, Depth=1)  # disabled
data_10 = Data(path_mapper_4)  # disabled
crv_cp = CurveClosestPoint(Point=data_9, Curve=data_10)  # -> Point, Parameter, Distance; disabled

# ---- group: CALCULATE DECIBEL (ABSTRACTION) / Same as Num Bounces
number_slider_12 = Slider(12, range=0..100)  # disabled

# ---- group: CALCULATE DECIBEL (ABSTRACTION)
number_slider_13 = Slider(36, range=0..100)  # disabled
number_slider_14 = Slider(12, range=0..100)  # disabled

# ---- group: CALCULATE DECIBEL (ABSTRACTION) / Steps to cycle through
series_2 = Series(Start=0, Step=1, Count=number_slider_12)  # disabled

# ---- group: CREATE ANALYSIS GRID
demesh_2 = DeconstructMesh(Mesh=mesh)  # -> Vertices, Faces, Colours, Normals; disabled
item_4 = ListItem(List=demesh_2.Vertices, Index=0, Wrap=True)  # -> Item, Item1, Item2, Item3; disabled
xy = XYPlane(Origin=item_4.Item)  # disabled
srf4pt = _4PointSurface(CornerA=item_4.Item, CornerB=item_4.Item1, CornerC=item_4.Item2, CornerD=item_4.Item3)  # disabled
debrep = DeconstructBrep(Brep=srf4pt)  # -> Faces, Edges, Vertices; disabled
item_5 = ListItem(List=debrep.Edges, Index=0, Wrap=True)  # -> Item, Item1; disabled
number_slider_15 = Slider(24, range=0..100)  # disabled
len_3 = Length(Curve=item_5.Item)  # disabled
len_4 = Length(Curve=item_5.Item1)  # disabled
division_5 = Division(A=len_3, B=number_slider_15)  # disabled
division_6 = Division(A=len_4, B=number_slider_15)  # disabled
divide = DivideDomain²(Domain=srf4pt, UCount=division_5, VCount=division_6)  # disabled
number_slider_16 = Slider(0.98, range=0..1)  # disabled
subsrf = Isotrim(Surface=srf4pt, Domain=divide)  # disabled
area = Area(Geometry=subsrf)  # -> Area, flatten(Centroid); disabled
scale = Scale(Geometry=subsrf, Center=area.Centroid, Factor=number_slider_16)  # -> Geometry, Transform; disabled
bbox = BoundingBox(Content=scale.Geometry, Plane=PlaneXY(0, 0, 0))  # -> Box, Box_2; disabled

# ----
number_slider_17 = Slider(0.5, range=0..1)  # disabled
number_slider_18 = Slider(6, range=0..10)  # disabled
division_7 = Division(A=number_slider_15, B=number_slider_18)  # disabled
panel_19 = Panel(".5")  # disabled
division_8 = Division(A=len_3, B=division_7)  # disabled
division_9 = Division(A=len_4, B=division_7)  # disabled
number_slider_19 = Slider(18, range=0..39)  # disabled

# ---- group: CALCULATE DECIBEL (ABSTRACTION)
# MULTIPLIER SHOULD BE APPLIED TO THE dB, NOT THE DIST
# Take each dB val and multiply it by the multiplier
# but first aggregate the multiplier
number_slider_20 = Slider(13, range=0..100)  # disabled
ma = MassAddition(Input=data_6)  # -> Result, PartialResults; disabled
panel_20 = Panel(ma.PartialResults)  # disabled
number_slider_21 = Slider(1, range=0..1)  # disabled
python = PythonScript(A=replace, N=series_2)  # -> out, a; inputs A: list, N: Int32; disabled
# ---------- python: Python ----------
import rhinoscriptsyntax as rs

val = 1
i = 0
while (i < N):
    val = val * A[i]
    i+=1

a = val
# ---------- end python ----------
panel_21 = Panel("-1")  # disabled
shift = ShiftList(List=python.a, Shift=1, Wrap=True)  # disabled
partition_4 = PartitionList(List=flatten(shift), Size=number_slider_13)  # -> simplify(Chunks); disabled
partition_5 = PartitionList(List=partition_4, Size=number_slider_14)  # -> simplify(Chunks); disabled
cull_i_3 = CullIndex(List=shift, Indices=panel_21, Wrap=True)  # disabled
panel_22 = Panel(replace)  # disabled
number_slider_22 = Slider(11, range=0..100)  # disabled
number_slider_23 = Slider(5, range=0..10)  # disabled
panel_24 = Panel(cull_i_3)  # disabled
panel_25 = Panel("1")  # disabled
panel_26 = Panel("3")  # disabled
panel_27 = Panel("12")  # disabled
multiplication_4 = Multiplication(A=panel_27, B=number_slider_9)  # disabled
round = Round(Number=crv_cp.Parameter)  # -> Nearest, Floor, Ceiling; disabled
panel_28 = Panel("3")  # disabled

# ---- group: CALCULATE DECIBEL (ABSTRACTION) / Non-Zero
addition = Addition(A=ma.PartialResults, B=number_slider_21)  # disabled

# ---- group: CALCULATE DECIBEL (ABSTRACTION) / dB
python_2 = PythonScript(x=addition)  # -> out, a; disabled
# ---------- python_2: Python ----------
import math
a = (60-abs(20*math.log10(36.0/x)))
# ---------- end python_2 ----------

# ---- group: CALCULATE DECIBEL (ABSTRACTION) (continued)
multiplication_5 = Multiplication(A=python_2.a, B=partition_5)  # disabled
replace_2 = ReplaceItems(List=multiplication_5, Item=panel_25, Indices=number_slider_22, Wrap=False)  # -> simplify(List); disabled
panel_29 = Panel(replace_2)  # disabled
path_mapper_5 = PathMapper(replace_2, source="{A;B}(i)", target="{A;i}(B)")  # disabled
ma_2 = MassAddition(Input=path_mapper_5)  # -> Result, PartialResults; disabled
division_10 = Division(A=ma_2.Result, B=panel_26)  # disabled
trim_3 = TrimTree(Tree=division_10, Depth=1)  # disabled
panel_30 = Panel(trim_3)  # disabled
repeat_4 = RepeatData(Data=trim_3, Length=multiplication_4)  # disabled
partition_6 = PartitionList(List=repeat_4, Size=panel_27)  # -> simplify(Chunks); disabled
path_mapper_6 = PathMapper(partition_6, source="{A;B}(i)", target="{B;A}(i)")  # disabled
data_11 = Data(path_mapper_6)  # disabled
item_6 = ListItem(List=data_11, Index=round.Floor, Wrap=True)  # disabled
ma_3 = MassAddition(Input=item_6)  # -> Result, PartialResults; disabled
division_11 = Division(A=ma_3.Result, B=panel_28)  # disabled

# ---- group: ALL RECORDED DATA
panel_31 = Panel("62 frames || 5120 meshes || 384 grids")  # disabled
mmx = MeshMesh(MeshA=trim_2, MeshB=mesh, UseMeshMeshFast=True)  # disabled
lng_2 = ListLength(List=mmx)  # disabled
panel_32 = Panel(mmx)  # disabled
addition_2 = Addition(A=lng_2, B=1)  # disabled
curvepoint = PointOnCurve(mmx, parameter=0.5)  # disabled
trim_4 = TrimTree(Tree=addition_2, Depth=1)  # disabled
lng_3 = ListLength(List=trim_4)  # disabled
series_3 = Series(Start=0, Step=1, Count=lng_3)  # -> simplify(Series); disabled
panel_33 = Panel("1")  # disabled
debox = DeconstructBox(Box=bbox.Box)  # -> Plane, X, Y, Z; disabled
pdecon = Deconstruct(Point=curvepoint)  # -> XComponent, YComponent, ZComponent; disabled
trim_5 = TrimTree(Tree=lng_2, Depth=1)  # disabled
equals = Equality(FirstNumber=trim_5, SecondNumber=panel_33)  # -> Equality, Inequality; disabled
inc = Includes(Value=flatten(pdecon.XComponent), Domain=graft(debox.X))  # -> simplify(Includes), Deviation; disabled
inc_2 = Includes(Value=flatten(pdecon.YComponent), Domain=graft(debox.Y))  # -> simplify(Includes), Deviation; disabled
trim_6 = TrimTree(Tree=curvepoint, Depth=1)  # disabled
and = GateAnd(A=inc.Includes, B=inc_2.Includes)  # disabled
lng_4 = ListLength(List=debox.X)  # disabled
trim_7 = TrimTree(Tree=division_11, Depth=1)  # disabled
cull = CullPattern(List=series_3, CullPattern=equals.Equality)  # disabled
cull_2 = CullPattern(List=trim_7, CullPattern=equals.Equality)  # -> flatten(List); disabled
lng_5 = ListLength(List=cull_2)  # disabled
multiplication_6 = Multiplication(A=lng_5, B=lng_4)  # disabled
repeat_5 = RepeatData(Data=cull_2, Length=multiplication_6)  # disabled
partition_7 = PartitionList(List=repeat_5, Size=lng_5)  # -> simplify(Chunks); disabled
dispatch_3 = Dispatch(List=partition_7, DispatchPattern=and)  # -> ListA, ListB; disabled

# ---- group: DISPLAY LINES
panel_34 = Panel("2")  # disabled
trim_8 = TrimTree(Tree=mmx, Depth=1)  # disabled
trim_9 = TrimTree(Tree=division_11, Depth=1)  # disabled
lng_6 = ListLength(List=mmx)  # disabled
group = Group(Objects=trim_8)  # -> flatten(Group); disabled
panel_35 = Panel("1")  # disabled
equals_2 = Equality(FirstNumber=lng_6, SecondNumber=panel_35)  # -> Equality, Inequality; disabled
trim_10 = TrimTree(Tree=equals_2.Equality, Depth=1)  # disabled
series_4 = Series(Start=0, Step=1, Count=10)  # disabled
item_7 = ListItem(List=group, Index=number_slider_19, Wrap=True)  # disabled
ungroup = Ungroup(Group=item_7)  # disabled
cull_3 = CullPattern(List=series_3, CullPattern=trim_10)  # disabled
len_5 = Length(Curve=ungroup)  # disabled
item_8 = ListItem(List=trim_9, Index=cull_3, Wrap=True)  # disabled
pt_4 = ConstructPoint(XCoordinate=0, YCoordinate=0, ZCoordinate=item_8)  # disabled
group_2 = Group(Objects=pt_4)  # -> flatten(Group); disabled
panel_36 = Panel(len_5)  # disabled
item_9 = ListItem(List=group_2, Index=number_slider_19, Wrap=True)  # disabled
smaller = SmallerThan(FirstNumber=len_5, SecondNumber=number_slider_19)  # -> SmallerThan, OrEqualTo; disabled
ungroup_2 = Ungroup(Group=item_9)  # disabled
pdecon_2 = Deconstruct(Point=ungroup_2)  # -> XComponent, YComponent, ZComponent; disabled
dispatch_4 = Dispatch(List=len_5, DispatchPattern=smaller.OrEqualTo)  # -> ListA, ListB; disabled
division_12 = Division(A=dispatch_4.ListA, B=dispatch_4.ListA)  # disabled
multiplication_7 = Multiplication(A=number_slider_19, B=division_12)  # disabled
weave_3 = Weave(Pattern=smaller.OrEqualTo, Stream0=dispatch_4.ListB, Stream1=multiplication_7, NullGaps=False)  # disabled
division_13 = Division(A=pdecon_2.ZComponent, B=weave_3)  # disabled
panel_37 = Panel("2.5")  # disabled
gradient = Gradient(LowerLimit=0, UpperLimit=panel_37, Parameter=division_13, stops=[0.00476: RGB(0, 0, 0), 1: RGB(255, 255, 255)])  # disabled

# ----
preview = CustomPreview(Geometry=ungroup, Material=gradient)  # disabled

# ---- group: DECIBEL ADDITION (ABSTRACT)
clean = CleanTree(RemoveNulls=True, RemoveInvalid=True, RemoveEmpty=True, Tree=dispatch_3.ListA)  # disabled
lng_7 = ListLength(List=flatten(clean))  # disabled
button = Button()  # disabled
panel_38 = Panel(clean)  # disabled
panel_39 = Panel(lng_7)  # disabled
flip = FlipMatrix(Data=clean)  # disabled
number_slider_24 = Slider(19, range=0..100)  # disabled
ma_4 = MassAddition(Input=flip)  # -> Result, PartialResults; disabled
division_14 = Division(A=ma_4.Result, B=number_slider_24)  # disabled
flip_2 = FlipMatrix(Data=division_14)  # disabled
flatten = FlattenTree(Tree=flip_2, Path="{0}")  # disabled
panel_40 = Panel(flatten)  # disabled
ma_5 = MassAddition(Input=flatten)  # -> Result, PartialResults; disabled
number_slider_25 = Slider(5, range=0..10)  # disabled
lng_8 = ListLength(List=ma_5.PartialResults)  # disabled
series_5 = Series(Start=0, Step=number_slider_25, Count=lng_8)  # disabled
pt_5 = ConstructPoint(XCoordinate=series_5, YCoordinate=ma_5.PartialResults, ZCoordinate=0)  # disabled
pline = PolyLine(Vertices=pt_5, Closed=False)  # disabled
panel_41 = Panel(".1")  # disabled
lng_9 = ListLength(List=subsrf)  # disabled
series_6 = Series(Start=0, Step=1, Count=lng_9)  # disabled
panel_42 = Panel("1")  # disabled
panel_43 = Panel("0")  # disabled

# ---- group: DECIBEL ADDITION (ABSTRACT) / Flat @ 0.6
number_slider_26 = Slider(1, range=0..1)  # disabled
number_slider_27 = Slider(0, range=0..100)  # disabled
sort = SortList(Keys=clean)  # -> Keys, ValuesA; disabled
data_12 = Data(sort.Keys)  # disabled
sort_2 = SortList(Keys=data_12)  # -> reverse(Keys), ValuesA; disabled
lng_10 = ListLength(List=sort_2.Keys)  # disabled
subtraction_2 = Subtraction(A=lng_10, B=number_slider_26)  # disabled
repeat_6 = RepeatData(Data=number_slider_26, Length=subtraction_2)  # -> simplify(Data); disabled
repeat_7 = RepeatData(Data=number_slider_27, Length=subtraction_2)  # -> simplify(Data); disabled
item_10 = ListItem(List=repeat_6, Index=0, Wrap=True)  # disabled
merge_3 = Merge(Data1=item_10, Data2=repeat_7)  # disabled
dispatch_5 = Dispatch(List=sort_2.Keys, DispatchPattern=merge_3)  # -> simplify(ListA), simplify(ListB); disabled
sort_3 = SortList(Keys=dispatch_5.ListB)  # -> reverse(Keys), ValuesA; disabled
panel_44 = Panel("""0.0
0.5
1.0
1.5
2.0
2.5
3.0
3.5
4.0
4.5
5.0
5.5
6.0
6.5
7.0
7.5
8.0
8.5
9.0
9.5
10
14
18
24""")  # disabled
panel_45 = Panel("""3.0
2.8
2.5
2.3
2.1
1.9
1.7
1.6
1.4
1.3
1.2
1.1
1.0
0.9
0.8
0.7
0.7
0.6
0.6
0.5
0.4
0.2
0.1
.001""")  # disabled
number_slider_28 = Slider(1000, range=0..1000)  # disabled
pt_6 = ConstructPoint(XCoordinate=panel_44, YCoordinate=panel_45, ZCoordinate=0)  # disabled
number_slider_29 = Slider(100, range=0..100)  # disabled
number_slider_30 = Slider(3, range=0..10)  # disabled
number_slider_31 = Slider(5, range=0..10)  # disabled
pline_2 = PolyLine(Vertices=pt_6, Closed=False)  # disabled
pt_7 = ConstructPoint(XCoordinate=number_slider_29, YCoordinate=0, ZCoordinate=0)  # disabled
reb_2 = RebuildCurve(Curve=pline_2, Degree=number_slider_30, Count=number_slider_31, Tangents=False)  # disabled
end = EndPoints(Curve=reb_2)  # -> Start, End; disabled
ln = Line(StartPoint=end.End, EndPoint=pt_7)  # disabled
join_2 = JoinCurves(Curves=[reb_2, ln], Preserve=False)  # disabled
number_slider_32 = Slider(19, range=0..100)  # disabled

# ---- group: DECIBEL ADDITION (ABSTRACT) (continued)
panel_46 = Panel(sort_3.Keys)  # disabled
addition_3 = Addition(A=dispatch_5.ListA, B=0.1)  # disabled
lng_11 = ListLength(List=subtraction_2)  # -> flatten(Length); disabled
lng_12 = ListLength(List=dispatch_5.ListB)  # -> flatten(Length); disabled
sort_4 = SortList(Keys=lng_12)  # -> Keys, ValuesA; disabled
sort_5 = SortList(Keys=lng_11)  # -> Keys, ValuesA; disabled
item_11 = ListItem(List=merge_3, Index=0, Wrap=True)  # disabled
simplify = SimplifyTree(Tree=item_11, Front=False)  # disabled
branch = TreeBranch(Tree=simplify, Path=series_6, MaintainPaths=True)  # disabled
lng_13 = ListLength(List=branch)  # disabled
equals_3 = Equality(FirstNumber=lng_13, SecondNumber=panel_42)  # -> Equality, Inequality; disabled

# ---- group: DECIBEL ADDITION (ABSTRACT) / Flat @ 0.6 (continued)
python_3 = PythonScript(StartingValue=addition_3, TestValues=sort_3.Keys, GraphCurve=join_2)  # -> simplify(out), a; inputs TestValues: list, GraphCurve: Curve; disabled
# ---------- python_3: Python ----------
#start with the starting value
#subtract the first item of the test value
#you now have the difference between the two
#plot this on the graph to find its Y coodinate
#add that value to the starting value
#repeat step 2 using the new value as the start

import rhinoscriptsyntax as rs

val = StartingValue
pointlist = []

for i in TestValues:
    Diff = val - i
    newPoint = rs.AddPoint(Diff,-1,0)
    farPoint = rs.AddPoint(Diff,4,0)
    newLine = rs.AddLine(newPoint,farPoint)
    intersect = rs.CurveCurveIntersection(newLine, GraphCurve)
    if intersect:
        point1 = intersect[0]
    else:
        point1 = [0,0,0]
    elements = str(point1).split("[")
    firstElement = elements[1]
    elementNew = firstElement.split("]")
    numberSplit = elementNew[0].split(",")
    YVal = numberSplit[1]
    val = val+float(YVal)
print(val)
a = val
# ---------- end python_3 ----------
ma_6 = MassAddition(Input=python_3.out)  # -> flatten(Result), PartialResults; disabled
ma_7 = MassAddition(Input=ma_6.Result)  # -> flatten(Result), PartialResults; disabled
division_15 = Division(A=ma_7.Result, B=number_slider_32)  # disabled
panel_47 = Panel(division_15)  # disabled

# ---- group: DECIBEL ADDITION (ABSTRACT) (continued)
panel_48 = Panel(python_3.out)  # disabled
flatten_2 = FlattenTree(Tree=python_3.out, Path="{0}")  # disabled
sort_6 = SortList(Keys=flatten_2)  # -> Keys, ValuesA; disabled
panel_49 = Panel(sort_6.Keys)  # disabled
flatten_3 = FlattenTree(Tree=python_3.out, Path="{0}")  # disabled
lng_14 = ListLength(List=flatten_3)  # disabled
subtraction_3 = Subtraction(A=lng_9, B=lng_14)  # disabled
simplify_2 = SimplifyTree(Tree=python_3.out, Front=False)  # disabled
repeat_8 = RepeatData(Data=panel_43, Length=subtraction_3)  # disabled
weave_4 = Weave(Pattern=flatten(equals_3.Inequality), Stream0=flatten(simplify_2), Stream1=flatten(repeat_8), NullGaps=False)  # disabled

# ---- group: DISPLAY CONTOURS
Z = UnitZ(Factor=weave_4)  # disabled
move_2 = Move(Geometry=area.Centroid, Motion=Z)  # -> Geometry, Transform; disabled
srfgrid = SurfaceFromPoints(Points=move_2.Geometry, UCount=division_5, Interpolate=False)  # disabled
number_slider_33 = Slider(100, range=0..100)  # disabled

# ----
rebuildsrf = RebuildSurface(Surface=srfgrid, UDegree=3, VDegree=3, UNumber=division_8, VNumber=division_9)  # disabled

# ---- group: DISPLAY CONTOURS (continued)
contour = Contour(Shape=rebuildsrf, Point=Point(0, 0, 0), Direction=Vector(0, 0, 1), Distance=number_slider_17)  # disabled
item_12 = ListItem(List=contour, Index=0, Wrap=True)  # disabled
project = Project(Geometry=contour, Plane=xy)  # -> Geometry, Transform; disabled
end_2 = EndPoints(Curve=item_12)  # -> Start, End; disabled
pdecon_3 = Deconstruct(Point=end_2.Start)  # -> XComponent, YComponent, ZComponent; disabled
group_3 = Group(Objects=project.Geometry)  # disabled
flatten_4 = FlattenTree(Tree=pdecon_3.ZComponent, Path="{0}")  # disabled
bnd = Bounds(Numbers=flatten_4)  # disabled
dedomain = DeconstructDomain(Domain=bnd)  # -> Start, End; disabled
gradient_2 = Gradient(
    LowerLimit=number_slider_33,
    UpperLimit=dedomain.End,
    Parameter=pdecon_3.ZComponent,
    stops=[0: RGB(5, 1, 0), 0.115: RGB(0, 0, 0), 0.2: RGB(0, 0, 0), 0.3: RGB(103, 0, 120), 0.4: RGB(39, 72, 161), 0.5: RGB(1, 192, 229), 0.6: RGB(18, 178, 90), 0.7: RGB(79, 186, 8), 0.8: RGB(220, 237, 32), 0.9: RGB(247, 159, 20), 1: RGB(243, 57, 0)])  # disabled

# ----
divide_2 = DivideDomain²(Domain=srfgrid, UCount=division_8, VCount=division_9)  # disabled
subsrf_2 = Isotrim(Surface=srfgrid, Domain=divide_2)  # disabled
area_2 = Area(Geometry=subsrf_2)  # -> Area, Centroid; disabled
smesh = SimpleMesh(Brep=subsrf_2)  # disabled
pdecon_4 = Deconstruct(Point=area_2.Centroid)  # -> XComponent, YComponent, ZComponent; disabled
gradient_3 = Gradient(
    LowerLimit=number_slider_33,
    UpperLimit=dedomain.End,
    Parameter=pdecon_4.ZComponent,
    stops=[0: RGB(5, 1, 0), 0.115: RGB(0, 0, 0), 0.2: RGB(0, 0, 0), 0.3: RGB(103, 0, 120), 0.4: RGB(39, 72, 161), 0.5: RGB(1, 192, 229), 0.6: RGB(18, 178, 90), 0.7: RGB(79, 186, 8), 0.8: RGB(220, 237, 32), 0.9: RGB(247, 159, 20), 1: RGB(243, 57, 0)])  # disabled
mcol = MeshColours(Mesh=simplify(graft(smesh)), Colours=simplify(graft(gradient_3)))  # disabled
preview_2 = CustomPreview(Geometry=group_3, Material=gradient_2)  # disabled
project_2 = Project(Geometry=mcol, Plane=xy)  # -> Geometry, Transform; disabled
